# Grasshopper definition sine.gh (Grasshopper 0.9.76)
# plug-ins: AutoGraph

list = ValueList({"One": 0, "Two": 1, "Three": 2}, selected="One")
distance_from_ref_crv = Slider(13, range=0..1000)
wave_count = Slider(4, range=0..100)
crv = Curve(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)
divide = DivideCurve(Curve=reparameterize(crv), Count=Slider(734, range=0..1000), Kinks=False)  # -> Points, Tangents, Parameters
points = AGDataDescription(divide.Points)
number_slider = AGDataDescription(distance_from_ref_crv)
points_2 = AGDataDescription(divide.Parameters)
vector_a = AGDataDescription(divide.Tangents)
number_slider_2 = AGDataDescription(wave_count)
vector_a_2 = AGDataDescription(vector_a)
points_3 = AGDataDescription(points_2)
pi = Pi(Factor=number_slider_2)
bnd = Bounds(Numbers=points_3)
points_4 = AGDataDescription(points_3)
remap = RemapNumbers(Value=points_4, Source=bnd, Target=pi)  # -> Mapped, Clipped
number_slider_3 = AGDataDescription(distance_from_ref_crv)
neg = Negative(Value=number_slider_3)
mapped = AGDataDescription(remap.Mapped)
Z = UnitZ(Factor=1)
sin = Sine(Value=mapped)
sin_2 = Sine(Value=mapped)
mapped_2 = AGDataDescription(mapped)
sin_3 = Sine(Value=sin_2)
filter = StreamFilter(Gate=list, Stream0=mapped_2, Stream1=sin, Stream2=sin_3)
dom = ConstructDomain(DomainStart=neg, DomainEnd=number_slider_3)
xprod = CrossProduct(VectorA=vector_a_2, VectorB=Z, Unitize=False)  # -> Vector, Length
sin_4 = Sine(Value=filter)
bnd_2 = Bounds(Numbers=sin_4)
domain = AGDataDescription(dom)
remap_2 = RemapNumbers(Value=sin_4, Source=bnd_2, Target=domain)  # -> Mapped, Clipped
mapped_3 = AGDataDescription(remap_2.Mapped)
vector = AGDataDescription(xprod.Vector)
amp = Amplitude(Vector=vector, Amplitude=mapped_3)
points_5 = AGDataDescription(points)
move = Move(Geometry=points_5, Motion=amp)  # -> Geometry, Transform
intcrv = Interpolate(Vertices=move.Geometry, Degree=3, Periodic=False, KnotStyle=1)  # -> Curve, Length, Domain
